# Grasshopper definition Test1.ghx (Grasshopper 1.0.8)
# Copyright: Copyright 2024 Corgan Associates, Inc

# Corgan Practice Technology Grasshopper Template 0.1
number_slider = Slider(10, range=0..50)
populate_3d = Populate3D(Region={Plane=PlaneXY(0, 0, 0), X=Domain(0, 10), Y=Domain(0, 10), Z=Domain(0, 2)}, Count=number_slider, Seed=1)
panel = Panel(populate_3d)
voronoi = Voronoi(Points=populate_3d, BruteForceOverride=False)
pt = Point(populate_3d)
crv = Curve(voronoi)
lng = ListLength(List=crv)
sphere = Sphere(Base=pt, Radius=1)
cone = Cone(Base=pt, Radius=lng, Length=1)  # -> Cone, Tip
